# Grasshopper definition db_fetcher.gh (Grasshopper 1.0.7)
# plug-ins: NGon, Chimera, ArchNet, Heteroptera

# ---- group: Step 1: Set Working Directory
# DB Fetcher
# v1.1.0
# Change notes:
# v1.1.0: Add support for block import
# Add support for auto scale from model_scale field
# 1. API call to get database
# v1.0.0: Implement RESTful API call (Async), replacing manual CSV download and read process.
# Implement database local caching, reduce API call frequency.
# Implement smart local assests check, only download assests that are updated.
# Implement unzip operation for item compressed using gzip.
# Implement brep import handeling. It will now check if imported model is .3dm or .obj and import accordingly.
working_directory = Panel("G:\cache\project\mongrel_assembly\db")

# ----
domain = Panel("https://mongrel-assembly-rest-api.onrender.com")
api_key = Panel("wSTjBDc88bULaTW0kjSzkA")
endpoint = ValueList({"/getdata"}, selected="/getdata")

# ---- group: Step 2: Fetch from data source if no cache
# Note: API Server will spin down with inactivity. So first time updating from source might take a while.
get = RESTGETText(URL=domain, EndPt=endpoint, Headers="x-api-key", KEY=api_key)

# ----
cache_file_name = Panel("\db_cache")
list = ValueList({"Text File": ".txt", "CSV File": ".csv", "JSON File": ".json", "YAML File": ".yml"}, selected="JSON File")
path = CreatePath(Directory=working_directory, Filename=cache_file_name, Extension=list, Mode="text")
refresh = Button()

# ---- group: Step 3: Cache database to local directory
run = Button()

# ----
caching = GhPythonScript(json_str=get, path=path, run=run, refresh=refresh)  # -> info; inputs run: Boolean
# ---------- caching: Python ----------
import json
import csv
import os

import Grasshopper.Kernel as gh

def check_cache(p):
    if os.path.isfile(p) and os.path.getsize(p) > 0:
        return True
    return False

def parse_json(json_string):
    data = json.loads(json_string)
    return data

csv_file = path
if check_cache(csv_file):
    info = True
    ghenv.Component.Message = "Cache Exists."
else:
    info = False
    ghenv.Component.Message = "Cache Not Exists.\nRun GET request."

if run:
    if json_str is not None:
        # Read the JSON string
        data = parse_json(json_str)  # This could be a dictionary or a list of dictionaries
        with open(path, "w") as f:
            json.dump(data, f, indent=2, sort_keys=True)
# ---------- end caching ----------
cull = CullPattern(List=path, CullPattern=caching)
convert_to_csv = GhPythonScript(json_path=cull)  # -> csv_path
# ---------- convert_to_csv: Python ----------
import json
import csv
import os

def read_json(json_file):
    with open(json_file) as f:
        data = json.load(f)
    return data[0]  # Only use the first item in the list (the list of dictionaries)

def get_headers(data):
    headers = set()
    for entry in data:
        for key in entry.keys():
            headers.add(key)
    return list(headers)

def flatten_lists(entry):
    for key in entry:
        if isinstance(entry[key], list):  # Check if the value is a list
            entry[key] = ", ".join(entry[key])  # Convert the list into a comma-separated string
    return entry

def write_csv(data, csv_file, headers):
    with open(csv_file, 'wb') as f:  # Use 'wb' instead of 'w'
        writer = csv.DictWriter(f, headers)
        writer.writeheader()
        for entry in data:
            entry = flatten_lists(entry)
            writer.writerow(entry)

def change_extension(file_path, extension):
    """Changes the extension of the given file to .csv"""
    base = os.path.splitext(file_path)[0]
    return base + extension

def json_to_csv(json_file, csv_file):
    try:
        data = read_json(json_file)
        headers = get_headers(data)
        write_csv(data, csv_file, headers)
    except Exception as e:
        return False
    return True

# use it
if json_path:
    result = json_to_csv(json_path, change_extension(json_path, '.csv'))
    if result:
        csv_path = change_extension(json_path, '.csv')
# ---------- end convert_to_csv ----------

# ---- group: Step 4: update csv
refresh_2 = Button()

# ---- group: Metadata Fields
panel = Panel("""spec_id
name
material
amount
unit
uid""")

# ----
read_fields = CSharpScript(csv=convert_to_csv)  # -> fields; inputs csv: String
# ---------- read_fields: C# usings ----------
using Microsoft.VisualBasic.FileIO;
# ---------- read_fields: C# ----------
    fields = GetCsvHeader(csv);
# ---------- read_fields: C# additional code ----------
  private List<string> GetCsvHeader(string path){
    List<string> headers = new List<string>();
    using (var parser = new TextFieldParser(path))
    {
      parser.SetDelimiters(",");
      if (!parser.EndOfData)
      {
        headers.AddRange(parser.ReadFields());
      }
    }
    return headers;
  }
# ---------- end read_fields ----------
csv_fields = Panel(read_fields)
# 2. Download geometry from database (GCP)
r_csv = CSharpScript(csv=convert_to_csv, col_pat="original_md5", refresh=refresh_2)  # -> data; inputs csv: String, col_pat: String, refresh: Boolean
# ---------- r_csv: C# usings ----------
using System.IO;
using System.Text.RegularExpressions;
# ---------- r_csv: C# ----------
    datas = SearchCsvColumn(csv, col_pat);
    data = datas;
# ---------- r_csv: C# additional code ----------
  List<string> datas = new List<string>();

  private List<string> SearchCsvColumn(string filePath, string pattern)
  {
    var matchedValues = new List<string>();

    if (!File.Exists(filePath))
    {
      Component.AddRuntimeMessage(GH_RuntimeMessageLevel.Error, "File not found");
      return null;
    }

    try
    {
      using (var reader = new StreamReader(filePath))
      {
        int lineCount = 0;
        int colIndex = -1;
        while (!reader.EndOfStream)
        {
          var line = reader.ReadLine();
          var values = ParseCsvLine(line);
          if (lineCount == 0)
          {
            for (var i = 0; i < values.Length; i++)
            {
              var value = values[i];
              if (value.StartsWith(pattern))
              {
                colIndex = i;
                Component.Message = "column: " + (colIndex + 1).ToString();
              }
            }
          }
          else
          {
            if (colIndex == -1)
            {
              Component.AddRuntimeMessage(GH_RuntimeMessageLevel.Error, "Column not found");
              return null;
            }
            for (int i = 0; i < values.Length; i++)
            {
              if (i == colIndex)
              {
                var value = values[i];
                if (value != null || value != String.Empty){
                  matchedValues.Add(value);
                }

              }
            }
          }
          lineCount++;
        }
      }
    }
    catch (Exception e)
    {
      Component.AddRuntimeMessage(GH_RuntimeMessageLevel.Error, e.Message);
      throw;
    }


    return matchedValues;
  }

  private string[] ParseCsvLine(string line)
  {
    var pattern = ",(?=(?:[^\"]*\"[^\"]*\")*(?![^\"]*\"))";
    var regex = new Regex(pattern);
    return regex.Split(line);
  }
# ---------- end r_csv ----------
r_csv_2 = CSharpScript(csv=convert_to_csv, col_pat="3d_model", refresh=refresh_2)  # -> data; inputs csv: String, col_pat: String, refresh: Boolean
# ---------- r_csv_2: C# ----------
    datas = SearchCsvColumn(csv, col_pat);
    data = datas;
# ---------- r_csv_2: C# additional code ----------
  List<string> datas = new List<string>();

  private List<string> SearchCsvColumn(string filePath, string pattern)
  {
    var matchedValues = new List<string>();

    if (!File.Exists(filePath))
    {
      Component.AddRuntimeMessage(GH_RuntimeMessageLevel.Error, "File not found");
      return null;
    }

    try
    {
      using (var reader = new StreamReader(filePath))
      {
        int lineCount = 0;
        int colIndex = -1;
        while (!reader.EndOfStream)
        {
          var line = reader.ReadLine();
          var values = ParseCsvLine(line);
          if (lineCount == 0)
          {
            for (var i = 0; i < values.Length; i++)
            {
              var value = values[i];
              if (value.StartsWith(pattern))
              {
                colIndex = i;
                Component.Message = "column: " + (colIndex + 1).ToString();
              }
            }
          }
          else
          {
            if (colIndex == -1)
            {
              Component.AddRuntimeMessage(GH_RuntimeMessageLevel.Error, "Column not found");
              return null;
            }
            for (int i = 0; i < values.Length; i++)
            {
              if (i == colIndex)
              {
                var value = values[i];
                matchedValues.Add(value);
              }
            }
          }
          lineCount++;
        }
      }
    }
    catch (Exception e)
    {
      Component.AddRuntimeMessage(GH_RuntimeMessageLevel.Error, e.Message);
      throw;
    }
    

    return matchedValues;
  }

  private string[] ParseCsvLine(string line)
  {
    var pattern = ",(?=(?:[^\"]*\"[^\"]*\")*(?![^\"]*\"))";
    var regex = new Regex(pattern);
    return regex.Split(line);
  }
# ---------- end r_csv_2 ----------

# ---- group: Step 5: Download 3d model
fetch = Button()

# ----
# 3. Fetch metadata from csv
r_csv_3 = CSharpScript(csv=convert_to_csv, col_pat=panel, refresh=refresh_2)  # -> data; inputs csv: String, col_pat: String, refresh: Boolean; same code as r_csv_2
concat = Concatenate(FragmentA=graft(panel), FragmentC=graft(": "), FragmentB=r_csv_3)

fetch_2 = CSharpScript(hashes=r_csv, urls=r_csv_2, tempDir=working_directory, fetch=fetch)  # -> localPaths, loc_hash; inputs hashes: list of String, urls: list of String, tempDir: String, fetch: Boolean
# ---------- fetch_2: C# usings ----------
using System.IO;
using System.Net;
using System.Security.Cryptography;
using System.Text;
using System.Security.Policy;
# ---------- fetch_2: C# ----------
    string unzipedDir = tempDir + "/unziped";
    if (fetch)
    {
      countExisting = 0;
      isRuned = true;
      msg = new List<string>();
      files = new List<string>();
      localHashes = new List<string>();
      try
      {
        WebClient client = new WebClient();
        if (!Directory.Exists(tempDir))
        {
          Directory.CreateDirectory(tempDir);
        }

        foreach (var url in urls)
        {
          string filename = url.Split('/')[url.Split('/').Length - 1];
          // get original file name
          string originalFilename = Path.GetFileNameWithoutExtension(filename);
          if (File.Exists(unzipedDir + "/" + originalFilename))
          {
            string existingHash = GetFileMd5Hash(unzipedDir + "/" + originalFilename);
            if (!hashes.Contains(existingHash)) // Check if the file's hash is not in the list of hashes
            {
              countExisting += 1;
              client.DownloadFile(new Uri(url), tempDir + "/" + filename);
              
              localHashes.Add(existingHash);
            }
          }
          else
          {
            countExisting += 1;
            client.DownloadFile(new Uri(url), tempDir + "/" + filename);
          }
          files.Add(tempDir + "/" + filename);
        }

      }
      catch (Exception e)
      {
        msg.Add(e.Message);
        errorInPreviousRun = true;
      }
    }

    if (files.Count > 0)
    {
      localPaths = files;
      loc_hash = localHashes;
    }


    if (errorInPreviousRun)
    {
      Component.AddRuntimeMessage(GH_RuntimeMessageLevel.Error, string.Join("\n", msg));
    }
    else if (isRuned)
    {
      Component.AddRuntimeMessage(GH_RuntimeMessageLevel.Remark, "File downloaded at: " + tempDir);
      Component.Message = "Downloaded " + countExisting;
    }
# ---------- fetch_2: C# additional code ----------
  private int countExisting;
  private List<string> localHashes;
  List<string> msg;
  private bool errorInPreviousRun = false;
  private bool isRuned = false;
  private List<string> files;

  public static string GetFileMd5Hash(string filePath)
  {
    using (var md5 = MD5.Create())
    {
      using (var stream = File.OpenRead(filePath))
      {
        var hash = md5.ComputeHash(stream);
        return ByteArrayToString(hash);
      }
    }
  }

  private static string ByteArrayToString(byte[] ba)
  {
    StringBuilder hex = new StringBuilder(ba.Length * 2);
    foreach (byte b in ba)
      hex.AppendFormat("{0:x2}", b);
    return hex.ToString();
  }
# ---------- end fetch_2 ----------

# ---- group: Step 6: unzip model
button = Button()

# ----
unzip = CSharpScript(paths=flatten(fetch_2.localPaths), run=button)  # -> unziped; inputs paths: list of String, run: Boolean
# ---------- unzip: C# usings ----------
using System.IO;
using System.IO.Compression;
# ---------- unzip: C# ----------
    if (run)
    {
      _files.Clear();
      string unzipPath = Path.GetDirectoryName(paths[0]) + "/unziped";

      // create a new folder
      Directory.CreateDirectory(unzipPath);
      int count = 0;
      foreach (var path in paths)
      {
        // check if the file is a gz file
        if (Path.GetExtension(path) == ".gz")
        {
          var decompressFile = DecompressFile(path, unzipPath);
          _files.Add(decompressFile);
          count++;
        }
        else
        {
          _files.Add(path);
        }
      }

      if (count == 0)
      {
        Component.Message = "No gz file found.";
      }
      else
      {
        Component.Message = "Done!\nUnzip " + count + " files";
      }

    }
    unziped = _files;
# ---------- unzip: C# additional code ----------
  private List<string> _files = new List<string>();

  private string DecompressFile(string path, string outDirectory)
  {
    var gzipFileName = Path.GetFileName(path); // Get the file name from the path (example.txt.gz)
    var originalFileName = Path.GetFileNameWithoutExtension(gzipFileName); // Remove the .gz extension (example.txt)

    var targetFilePath = Path.Combine(outDirectory, originalFileName); // Combine the output directory with the file name

    using (FileStream originalFileStream = File.OpenRead(path))
    {
      using (FileStream decompressedFileStream = File.Create(targetFilePath))
      {
        using (GZipStream decompressionStream = new GZipStream(originalFileStream, CompressionMode.Decompress))
        {
          decompressionStream.CopyTo(decompressedFileStream);
        }
      }
    }

    return targetFilePath;
  }
# ---------- end unzip ----------

# ---- group: Step 7: import models to gh
toggle = BooleanToggle(False)

# ----
import_mesh = CSharpScript(localPaths=unzip, import=toggle)  # -> out_geos; inputs localPaths: list of String, import: Boolean
# ---------- import_mesh: C# usings ----------
using System.Linq;
using System.IO;
# ---------- import_mesh: C# ----------
    if (import)
    {
      geometries.Clear();
      msg = "";
      int pathIndex = 0;
      foreach (var path in localPaths)
      {
        GH_Path ghPath = new GH_Path(pathIndex);
        if (path.EndsWith(".obj"))
        {
          var _geometries = ImportMesh(path);
          var combinedMesh = new Mesh();
          foreach (var geo in _geometries)
          {
            combinedMesh.Append(geo as Mesh);
          }
          geometries.Add(combinedMesh, ghPath);
        }
        else if (path.EndsWith(".3dm"))
        {
          var _geometries = Import3DM(path);
          if (_geometries.Count == 0)
          {
            Component.AddRuntimeMessage(GH_RuntimeMessageLevel.Error, "No geometry found in the file\n" + path);
            return;
          }
          else
          {
            foreach (var geo in _geometries)
            {
              geometries.Add(geo, ghPath);
            }
          }
        }
        else
        {
          msg = "File format not supported!";
          Component.AddRuntimeMessage(GH_RuntimeMessageLevel.Error, "File format not supported yet");
        }
        pathIndex++;
      }
      // After the import is done, turn off the import toggle
      ChangeInputToggle("import", false);
      msg = "Imported " + geometries.BranchCount.ToString() + " files";
    }
    out_geos = geometries;
    Component.Message = msg;
# ---------- import_mesh: C# additional code ----------
  //private List<GeometryBase> geometries = new List<GeometryBase>();
  private DataTree<GeometryBase> geometries = new DataTree<GeometryBase>();

  private string msg = "";

  private List<GeometryBase> ImportMesh(string path)
  {
    RhinoDoc.ActiveDoc.Objects.UnselectAll();
    string cmd = "-_Import \"" + path + "\" _Enter";
    Rhino.RhinoApp.RunScript(cmd, false);

    cmd = "-_SelAll _Enter";
    Rhino.RhinoApp.RunScript(cmd, false);

    cmd = "-_Mesh _Enter";
    Rhino.RhinoApp.RunScript(cmd, false);

    cmd = "-_SelMesh _Enter";
    Rhino.RhinoApp.RunScript(cmd, false);

    cmd = "-_Join _Enter";
    Rhino.RhinoApp.RunScript(cmd, false);

    // get the selected objects
    var selectObjs = RhinoDoc.ActiveDoc.Objects.GetSelectedObjects(false, false).ToList();
    List<GeometryBase> geos = new List<GeometryBase>();

    // get the meshes
    foreach (var selectObj in selectObjs)
    {
      GeometryBase geo = selectObj.Geometry;
      geos.Add(geo);
      RhinoDoc.ActiveDoc.Objects.Delete(selectObj, true);
    }
    return geos;
  }

  private List<GeometryBase> Import3DM(string path)
  {
    RhinoDoc.ActiveDoc.Objects.UnselectAll();
    string cmd = "-_Import \"" + path + "\" _Enter";
    Rhino.RhinoApp.RunScript(cmd, false);

    // check is selected objects are blocks
    var selectObjs = RhinoDoc.ActiveDoc.Objects.GetSelectedObjects(false, false).ToList();
    bool isBlock = false;

    foreach (var selectObj in selectObjs)
    {
      if (selectObj.ObjectType == Rhino.DocObjects.ObjectType.InstanceReference)
      {
        // if the selected object is a block, explode it
        isBlock = true;
        break;
      }
    }

    if (isBlock)
    {
      cmd = "-_ExplodeBlock _Enter";
      Rhino.RhinoApp.RunScript(cmd, false);
    }

    cmd = "-_Group _Enter _Enter";
    Rhino.RhinoApp.RunScript(cmd, false);

    // get the selected objects
    selectObjs = RhinoDoc.ActiveDoc.Objects.GetSelectedObjects(false, false).ToList();
    List<GeometryBase> geos = new List<GeometryBase>();
    foreach (var selectObj in selectObjs)
    {
      GeometryBase geo = selectObj.Geometry;
      geos.Add(geo);
      RhinoDoc.ActiveDoc.Objects.Delete(selectObj, true);
    }
    return geos;
  }

  public void ChangeInputToggle(string targetInputName, bool state)
  {
    List<IGH_Param> inputs = Component.Params.Input;
    foreach (IGH_Param input in inputs)
    {
      if (input.Name != targetInputName) continue;
      IList<IGH_Param> sources = input.Sources;
      foreach (IGH_Param source in sources)
      {
        IGH_Attributes attributes = source.Attributes;
        IGH_DocumentObject comp_obj = attributes.GetTopLevel.DocObject;
        if (comp_obj.GetType() == typeof(Grasshopper.Kernel.Special.GH_BooleanToggle))
        {
          var toggle = source as Grasshopper.Kernel.Special.GH_BooleanToggle;
          if (toggle == null) continue;
          if (toggle.Value == state) continue;
          toggle.Value = state;
          comp_obj.ExpireSolution(true);
        }
      }
    }
  }
# ---------- end import_mesh ----------

# ---- group: Step 8: Release dam
dam = DataDam(DataA=import_mesh, BufferDelay=10000000, BufferMode=0)

# ----
r_csv_4 = CSharpScript(csv=convert_to_csv, col_pat="model_scale", refresh=refresh_2)  # -> data; inputs csv: String, col_pat: String, refresh: Boolean; same code as r_csv_2

# ---- group: Scale Model
bbox = BoundingBox(Content=dam, Plane=PlaneXY(0, 0, 0), UnionBox=True)  # -> Box, Box_2
get_factor = CSharpScript(scale=r_csv_4)  # -> simplify(graft(factor)); inputs scale: String
# ---------- get_factor: C# ----------
    switch(scale) 
    {
      case "mm":
        factor = 1;
        break;
      case "cm":
        factor = 100;
        break;
      case "m":
        factor = 1000;
        break;
      default:
        factor = 1;
        break;
    }
# ---------- end get_factor ----------
center = Center(Geometrical=bbox.Box)  # -> Center, Dimension
scale = Scale(Geometry=dam, Center=center.Center, Factor=get_factor)  # -> Geometry, Transform

# ---- group: Text Controls
text_line_height = Slider(716, range=0..1000)
text_shift_left = Slider(1500, range=0..1500)
text_size = Slider(488, range=0..1000)
text_bold = BooleanToggle(True)

# ---- group: Grid Controls
# 4. Grid Controls
grid_size_u = Slider(2018, range=0..15000)
grid_size_v = Slider(7420, range=0..10000)
grid_u_count = Slider(15, range=0..100)
grid_v_count = Slider(10, range=0..100)

# ----
geo = Geometry(scale.Geometry)
group = Group(Objects=geo)  # -> flatten(Group)
ismesh = CSharpScript(geo=geo)  # -> isMesh; inputs geo: tree of GeometryBase
# ---------- ismesh: C# ----------
    var results = new DataTree<bool>();

    for (int i = 0; i < geo.BranchCount; i++)
    {
      var branchPath = geo.Path(i);
      var geometries = geo.Branch(i);

      bool nonMeshFound = false;
      bool meshFound = false;

      foreach (var geometry in geometries)
      {
        if (geometry is Rhino.Geometry.Mesh)
        {
          results.Add(true, branchPath);
          meshFound = true;
        }
        else
        {
          results.Add(false, branchPath);
          nonMeshFound = true;
        }
      }

      // If branch contains both mesh and non-mesh geometries
      if (meshFound && nonMeshFound)
      {
        Component.AddRuntimeMessage(GH_RuntimeMessageLevel.Error, "Branch at path " + branchPath + " contains a mix of mesh and non-mesh geometries.");
        return;
      }
    }

    isMesh = results;
# ---------- end ismesh ----------
dispatch = Dispatch(List=geo, DispatchPattern=ismesh)  # -> ListA, ListB

# ----
# Rotate Geometry
Y = UnitY(Factor=1)
Z = UnitZ(Factor=1)
pl = ConstructPlane(Origin=Point(0, 0, 0), XAxis=Y, YAxis=Z)
rotate = Rotate(Geometry=dispatch.ListA, Angle=1.570796327, Plane=pl)  # -> Geometry, Transform

cullnull = CullNull(InputList=rotate.Geometry)
merge = Merge(Data1=cullnull, Data2=dispatch.ListB)
group_2 = Group(Objects=merge)  # -> flatten(Group)

# ----
# Create Grid
lng = ListLength(List=group)
flip = FlipMatrix(Data=concat)
lng_2 = ListLength(List=flip)
series = Series(Start=text_line_height, Step=text_line_height, Count=lng_2)
neg = Negative(Value=series)
Y_2 = UnitY(Factor=neg)
neg_2 = Negative(Value=text_shift_left)
X = UnitX(Factor=neg_2)

# ----
# Orient Geometry
bbox_2 = BoundingBox(Content=merge, Plane=PlaneXY(0, 0, 0), UnionBox=True)  # -> flatten(Box), Box_2
brep = Brep(bbox_2.Box)
ground = GroundPlane(Geometry=brep)  # -> BaseGeo, GroundPlane, GroundCenterPoint
pl_2 = ConstructPlane(Origin=ground.GroundCenterPoint, XAxis=Vector(1, 0, 0), YAxis=Vector(0, 1, 0))

debox = DeconstructBox(Box=bbox_2.Box)  # -> Plane, X, Y, Z
num = Number(debox.X)
num_2 = Number(debox.Y)
num_3 = Number(debox.Z)
c_script = CSharpScript(num=num)  # -> largest, smallest; inputs num: list of Double
# ---------- c_script: C# usings ----------
using System.Linq;
# ---------- c_script: C# ----------
    double maxNumber = num.Max();
    double minNumber = num.Min();
    largest = maxNumber;
    smallest = minNumber;
# ---------- end c_script ----------
c_script_2 = CSharpScript(num=num_2)  # -> largest, smallest; inputs num: list of Double; same code as c_script
addition = Addition(A=c_script.largest, B=grid_size_u)
addition_2 = Addition(A=c_script_2.largest, B=grid_size_v)

create_grid = CSharpScript(maxPts=lng, sizeU=addition, sizeV=addition_2, u=grid_u_count, v=grid_v_count)  # -> pts, grid; inputs maxPts: Int32, sizeU: Double, sizeV: Double, u: Int32, v: Int32
# ---------- create_grid: C# ----------
    List<Point3d> points = new List<Point3d>();
    List<Polyline> polylines = new List<Polyline>();
    int count = 0;

    for (int i = 0; i < u; i++)
    {
      for (int j = 0; j < v; j++)
      {
        if (count >= maxPts)
        {
          break;
        }
        double x = i * sizeU;
        double y = j * sizeV;
        Point3d pt = new Point3d(x, y, 0);
        points.Add(pt);

        Polyline pl = new Polyline(5);
        pl.Add(x - sizeU / 2, y - sizeV / 2, 0);
        pl.Add(x + sizeU / 2, y - sizeV / 2, 0);
        pl.Add(x + sizeU / 2, y + sizeV / 2, 0);
        pl.Add(x - sizeU / 2, y + sizeV / 2, 0);
        pl.Add(pl[0]); // Closing the polyline
        polylines.Add(pl);

        count++;
      }

      // To exit outer loop as well when the max point limit is reached
      if (count >= maxPts)
      {
        break;
      }
    }

    pts = points;
    grid = polylines;
# ---------- end create_grid ----------
move = Move(Geometry=graft(create_grid.pts), Motion=Y_2)  # -> Geometry, Transform
move_2 = Move(Geometry=move.Geometry, Motion=X)  # -> Geometry, Transform

# ----
# Create Metadata Text Curve
number_slider = Slider(1, range=0..1)
flip_2 = FlipMatrix(Data=concat)
text = Text(
    Location=move_2.Geometry,
    Text=flip_2,
    Size=text_size,
    Bold=text_bold,
    HorizontalAlignment=number_slider,
    VerticalAlignment=Slider(0, range=0..10))

pl_3 = ConstructPlane(Origin=create_grid.pts, XAxis=Vector(1, 0, 0), YAxis=Vector(0, 1, 0))
orient = Orient(Geometry=group_2, Source=pl_2, Target=pl_3)  # -> Geometry, Transform

# ---- group: Bake Here
# 5. Outputs
metadata_text = Curve(text)
geo_2 = Geometry(orient.Geometry)
grids = Curve(create_grid.grid)
